# Grasshopper definition 1-ImportLayers.gh (Grasshopper 1.0.8)
# plug-ins: Urbano2

geographic_boundary = GeographicBoundary(Left="-73.94159", Top="40.81953", Right="-73.92941", Bottom="40.81107")  # -> Boundary, CoordinateReference
relative_path = RelativePath(FileName="map_file")
panel = Panel(relative_path)
serialize_project_setting = SerializeProjectSetting(
    Directory=relative_path,
    Boundary=geographic_boundary.Boundary,
    Granularity="Block Group",
    DataLayers="All",
    CoordinateReference=geographic_boundary.CoordinateReference)
# NYC
project_setting = ProjectSetting(Json=serialize_project_setting)
import_terrain = ImportTerrain(ProjectSetting=project_setting, Colored=True)
import_data_blocks = ImportDataBlocks(ProjectSetting=project_setting, DataSource="urbano synthesized", Terrain=True)
import_buildings = ImportBuildings(ProjectSetting=project_setting, DataSource="osm", Terrain=True)  # -> _2DFootprints, _3DMeshes
import_streets = ImportStreets(ProjectSetting=project_setting, DataSource="osm", Terrain=True)
import_green_spaces = ImportGreenSpaces(ProjectSetting=project_setting, DataSource="osm", Terrain=True)
import_public_transits = ImportPublicTransits(ProjectSetting=project_setting, DataSource="osm", Terrain=True)  # -> TransitLines, TransitStops
