# Grasshopper definition 1_build_site_model.gh (Grasshopper 1.0.7)
# plug-ins: Urbano.Grasshopper

# ----
# Input geographic boundary
# in latitude and longitude
panel = Panel("-76.5078")

# ----
# Input working directory
workflow_template = WorkflowTemplate()  # -> Directories, Templates

geographic_boundary = GeographicBoundary(Left=panel, Top="42.4515", Right="-76.4746", Bottom="42.4342")  # -> Boundary, CoordinateReference
project_setting = ProjectSetting(Directory=workflow_template.Directories, Boundary=geographic_boundary.Boundary, Granularity="Block", Run=True)
concatenate = Concatenate(FragmentA=workflow_template.Directories, FragmentB="\ithaca_ESL.geojson")
concatenate_2 = Concatenate(FragmentA=workflow_template.Directories, FragmentB="\City_Managed_Trees\City_Managed_Trees.shp")
panel_2 = Panel(concatenate)

# ----
# Import terrain
import_terrain = ImportTerrain(ProjectSetting=project_setting)
boolean_toggle = BooleanToggle(True)

panel_3 = Panel(concatenate_2)

# ----
# Import geojson data
coordinate_reference = CoordinateReference(geographic_boundary.CoordinateReference)
text = Text(geographic_boundary.Boundary)
import_geojson = ImportGeojson(
    GeojsonFilePath=panel_2,
    CoordinateReference=coordinate_reference,
    CroppingBoundary=text,
    Terrain=boolean_toggle,
    Run=True)  # -> Polylines, Polygons, Points, CoordinateReference, Boundary

# ----
# Import shapefile data
coordinate_reference_2 = CoordinateReference(geographic_boundary.CoordinateReference)
text_2 = Text(geographic_boundary.Boundary)
import_shapefile = ImportShapefile(
    ShpFilePath=panel_3,
    CoordinateReference=coordinate_reference_2,
    CroppingBoundary=text_2,
    Terrain=boolean_toggle,
    Run=True)  # -> Polylines, Polygons, Points, CoordinateReference, Boundary

# ----
# Import OpenStreetMap data
import_osm = ImportOsm(
    ProjectSetting=project_setting,
    OsmFeatureQuery=["route=trolleybus", "route=bus", "route=coach", "route=aerialway", "route=share_taxi", "route=train", "route=subway", "route=light_rail", "route=monorail", "route=tram", "route=railway", "route=rail", "route=funicular", "route=ferry", "route_master=trolleybus", "route_master=bus", "route_master=coach", "route_master=aerialway", "route_master=share_taxi", "route_master=train", "route_master=subway", "route_master=light_rail", "route_master=monorail", "route_master=tram", "route_master=railway", "route_master=rail", "route_master=funicular", "route_master=ferry"],
    GeometryType="Polyline",
    Terrain=boolean_toggle,
    Run=True)  # -> ProjectSetting, Polylines, Polygons, Points
import_osm_2 = ImportOsm(
    ProjectSetting=project_setting,
    OsmFeatureQuery=["highway=motorway", "highway=trunk", "highway=primary", "highway=secondary", "highway=tertiary", "highway=unclassified", "highway=residential", "highway=service", "highway=motorway_link", "highway=trunk_link", "highway=primary_link", "highway=secondary_link", "highway=motorway_junction", "highway=yes", "highway=road", "highway=living street", "highway=footway", "highway=pedestrian", "highway=path", "highway=bridleway", "highway=cycleway", "highway=raceway", "highway=steps"],
    GeometryType="Polyline",
    Terrain=boolean_toggle,
    Run=True)  # -> ProjectSetting, Polylines, Polygons, Points
import_osm_3 = ImportOsm(
    ProjectSetting=project_setting,
    OsmFeatureQuery=["highway=bus_stop", "railway=tram_stop", "public_transport=platform", "public_transport=stop_position"],
    GeometryType=["Point", "Polyline"],
    Terrain=boolean_toggle,
    Run=True)  # -> ProjectSetting, Polylines, Polygons, Points

lookup_metadata = LookupMetadata(MetadataGeometry=import_geojson.Polygons, SearchKey="BldgHeight_M_ESL")
create_3d_mesh = Create3DMesh(Polygon=import_geojson.Polygons, Height=lookup_metadata, AlongZ=True)
