# Grasshopper definition 2-ImportCustomData.gh (Grasshopper 1.0.8)
# plug-ins: Urbano2

geographic_boundary = GeographicBoundary(Left="-73.94159", Top="40.81953", Right="-73.92941", Bottom="40.81107")  # -> Boundary, CoordinateReference
osm_feature_query = OsmFeatureQuery(OsmFeatureQuery=["highway=motorway", "highway=trunk", "highway=primary", "highway=secondary", "highway=tertiary", "highway=unclassified", "highway=residential", "highway=service", "highway=motorway_link", "highway=trunk_link", "highway=primary_link", "highway=secondary_link", "highway=motorway_junction", "highway=yes", "highway=road", "highway=living street", "highway=footway", "highway=pedestrian", "highway=path", "highway=bridleway", "highway=cycleway", "highway=raceway", "highway=steps"])
file_path = FilePath("C:\Users\zhjw_\Box\20241230_jingwen\Template\Accessible Pedestrian Signal Locations_20251007.geojson")
file_path_2 = FilePath("C:\Users\zhjw_\Box\20241230_jingwen\Template\NYC Parks Drinking Fountains_20251007\geo_export_47f77c7a-f1fa-4ec3-86aa-2ac2378b50b1.shp")
file_path_3 = FilePath("C:\Users\zhjw_\Box\20241230_jingwen\Template\map_file\40.8195,40.8111,-73.9294,-73.9416_Block Group.osm")
# NYC Parks Drinking Fountains
import_shp_file = ImportSHPFile(
    ShpFilePath=file_path_2,
    CoordinateReference=geographic_boundary.CoordinateReference,
    CroppingBoundary=geographic_boundary.Boundary,
    Terrain=False,
    Run=True)  # -> Polylines, Polygons, Points, CoordinateReference, Boundary
import_osm_file = ImportOSMFile(
    OsmFilePath=file_path_3,
    OsmFeatures=osm_feature_query,
    CoordinateReference=geographic_boundary.CoordinateReference,
    CroppingBoundary=geographic_boundary.Boundary,
    Terrain=False,
    Run=True)  # -> Polylines, Polygons, Points, CoordinateReference, Boundary
# Accessible Pedestrian Signal Locations
import_geojson_file = ImportGeojsonFile(
    GeojsonFilePath=file_path,
    CoordinateReference=geographic_boundary.CoordinateReference,
    CroppingBoundary=geographic_boundary.Boundary,
    Terrain=False,
    Run=True)  # -> Polylines, Polygons, Points, CoordinateReference, Boundary
