# Grasshopper definition 2_custom_import_osm_data.gh (Grasshopper 1.0.8)
# plug-ins: Urbano2

workflow_template = WorkflowTemplate()  # -> Directories, Templates, TemplateProjectSetting, ExampleOSMFilePath, ExampleShapefilePath, ExampleGeojsonPath
# Select from dropdown
# or input your own query
osm_feature_query = OsmFeatureQuery(OsmFeatureQuery="(parking)")
workflow_template_2 = WorkflowTemplate()  # -> Directories, Templates, ExampleProjectSetting, ExampleOSMFilePath, ExampleShapefilePath, ExampleGeojsonPath
panel = Panel(osm_feature_query)
import_osm_file = ImportOSMFile(OsmFilePath=workflow_template_2.ExampleOSMFilePath, OsmFeatures=panel, Terrain=False, Run=True)  # -> Polylines, Polygons, Points, CoordinateReference, Boundary
