# Grasshopper definition 3-MetaData.gh (Grasshopper 1.0.8)
# plug-ins: Urbano2

geographic_boundary = GeographicBoundary(Left="-73.94159", Top="40.81953", Right="-73.92941", Bottom="40.81107")  # -> Boundary, CoordinateReference
relative_path = RelativePath(FileName="map_file")
panel = Panel(relative_path)
serialize_project_setting = SerializeProjectSetting(
    Directory=relative_path,
    Boundary=geographic_boundary.Boundary,
    Granularity="Block Group",
    DataLayers="All",
    CoordinateReference=geographic_boundary.CoordinateReference)
# NYC
project_setting = ProjectSetting(Json=serialize_project_setting)
import_data_blocks = ImportDataBlocks(ProjectSetting=project_setting, DataSource="urbano synthesized", Terrain=False)
deconstruct_metadata = DeconstructMetadata(Metadata=import_data_blocks)  # -> Keys, Values
search_metadata = SearchMetadata(Metadata=import_data_blocks)
panel_2 = Panel(search_metadata)
panel_3 = Panel(deconstruct_metadata.Keys)
panel_4 = Panel(deconstruct_metadata.Values)

# ---- group: Visualization
# Map Visualization
urbano_gradient = UrbanoGradient(
    Reverse=False,
    stops=[0: RGB(234, 38, 0), 0.25: RGB(234, 126, 0), 0.5: RGB(254, 244, 84), 0.75: RGB(173, 203, 249), 1: RGB(75, 107, 169)])
panel_5 = Panel("block_residential_population")
map_settings = MapSettings(Gradient=urbano_gradient, Legend=True, LegendTitle=panel_5, Label=False)
boundary_surfaces = BoundarySurfaces(Edges=import_data_blocks)

# ----
lookup_metadata = LookupMetadata(MetadataGeometry=import_data_blocks, SearchKey=panel_5)

# ---- group: Visualization (continued)
draw_map = DrawMap(Geometries=boundary_surfaces, Values=lookup_metadata, MapSettings=map_settings)
