# Grasshopper definition 3_import_shapefile.gh (Grasshopper 1.0.8)
# plug-ins: Urbano2

# Path to example file
relative_path = RelativePath(FileName="2010_Census_Blocks_20260129.shp")
geographic_boundary = GeographicBoundary(Left="-74.023399", Top="40.716702", Right="-74", Bottom="40.699799")  # -> Boundary, CoordinateReference
import_shp_file = ImportSHPFile(ShpFilePath=relative_path, CroppingBoundary=geographic_boundary.Boundary, Terrain=False, Run=True)  # -> Polylines, Polygons, Points, CoordinateReference, Boundary
