# Grasshopper definition 4-Simulation.gh (Grasshopper 1.0.8)
# plug-ins: Urbano2

geographic_boundary = GeographicBoundary(Left="-73.94159", Top="40.81953", Right="-73.92941", Bottom="40.81107")  # -> Boundary, CoordinateReference
relative_path = RelativePath(FileName="map_file")
panel = Panel(relative_path)
serialize_project_setting = SerializeProjectSetting(
    Directory=relative_path,
    Boundary=geographic_boundary.Boundary,
    Granularity="Block Group",
    DataLayers="All",
    CoordinateReference=geographic_boundary.CoordinateReference)
# NYC
project_setting = ProjectSetting(Json=serialize_project_setting)
urbano_mobility_simulation_engine = UrbanoMobilitySimulationEngine(ProjectSetting=project_setting, SaveToFile=False, Run=True)  # -> ProjectSetting, Trips, StreetNetwork, PublicTransitNetwork, Blocks

# ---- group: Map Visualization
urbano_gradient = UrbanoGradient(
    Reverse=False,
    stops=[0: RGB(0, 98, 0), 0.25: RGB(81, 175, 17), 0.5: RGB(159, 198, 146), 0.75: RGB(170, 235, 41), 1: RGB(221, 255, 53)])
urbano_gradient_2 = UrbanoGradient(Reverse=False, stops=[0: RGB(0, 128, 0), 0.5: RGB(255, 255, 0), 1: RGB(255, 0, 0)])
urbano_gradient_3 = UrbanoGradient(
    Reverse=False,
    stops=[0: RGB(86, 28, 156), 0: RGB(234, 38, 0), 0.25: RGB(234, 126, 0), 0.5: RGB(254, 244, 84), 0.75: RGB(173, 203, 249), 1: RGB(75, 107, 169)])
curve = Curve(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)
curve_2 = Curve(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)
curve_3 = Curve(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)
map_settings = MapSettings(Gradient=urbano_gradient_3, Legend=True, LegendBound=curve_3, LegendTitle="Trip Volume From/To Blocks", Label=False)
map_settings_2 = MapSettings(Gradient=urbano_gradient_2, Legend=True, LegendBound=curve, LegendTitle="Trip Volume By Street", Label=False)
map_settings_3 = MapSettings(Gradient=urbano_gradient, Legend=True, LegendBound=curve_2, LegendTitle="Trip Volume By Transit", Label=False)
trip_volume_by_transit = TripVolumeByTransit(
    Trips=urbano_mobility_simulation_engine.Trips,
    PublicTransitNetwork=urbano_mobility_simulation_engine.PublicTransitNetwork,
    CoordinateReference=geographic_boundary.CoordinateReference,
    TimeOfDay="All Times of Day",
    FromActivity="From All Activities",
    ToActivity="To All Activities",
    MapSettings=map_settings_3)  # -> RoutePolylines, RouteTripVolume, CoordinateReference
trip_volume_by_streets = TripVolumeByStreets(
    Trips=urbano_mobility_simulation_engine.Trips,
    StreetNetwork=urbano_mobility_simulation_engine.StreetNetwork,
    CoordinateReference=geographic_boundary.CoordinateReference,
    TravelMode="(0): Walk",
    TimeOfDay="All Times of Day",
    FromActivity="From All Activities",
    ToActivity="To All Activities",
    MapSettings=map_settings_2)  # -> StreetPolylines, TripVolume, CoordinateReference
trip_volume_from_to_blocks = TripVolumeFromToBlocks(
    Trips=urbano_mobility_simulation_engine.Trips,
    Blocks=urbano_mobility_simulation_engine.Blocks,
    ToFrom=True,
    CoordinateReference=geographic_boundary.CoordinateReference,
    TravelMode="All Modes",
    TimeOfDay="All Times of Day",
    FromActivity="From All Activities",
    ToActivity="To All Activities",
    MapSettings=map_settings)  # -> BlockPolygon, TripVolume, CoordinateReference

# ---- group: Filter & Inspect Trip
filter_trips = FilterTrips(
    Trips=urbano_mobility_simulation_engine.Trips,
    TravelMode="All Modes",
    TravelDurationLevel="All Levels",
    Season="All Seasons",
    Weekday="All Week Days",
    TimeOfDay="(1): Morning (6am - 11am)",
    FromActivity="From All Activities",
    ToActivity="To All Activities",
    TravelerType="All Traveler Types",
    OriginBlockIds="360610210005")
inpsect_trip = InpsectTrip(Trip=filter_trips, InspectRoute=False)  # -> FromActivity, ToActivity, TravelMode, TravelTime, TimeOfDay, Order, OriginBlockId, DestinationBlockId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
panel_2 = Panel(inpsect_trip.DestinationBlockId)
panel_3 = Panel(inpsect_trip.ToActivity)

# ---- group: save and load
relative_path_2 = RelativePath(FileName="trip")
save_trips_to_file = SaveTripsToFile(Trips=urbano_mobility_simulation_engine.Trips, FilePath=relative_path_2, Overwrite=False)  # -> Success, FilePath; disabled
load_trip_from_file = LoadTripFromFile(FilePath=save_trips_to_file.FilePath, Blocks=urbano_mobility_simulation_engine.Blocks)  # disabled
