# Grasshopper definition 4_import_geojson.gh (Grasshopper 1.0.8)
# plug-ins: Urbano2

workflow_template = WorkflowTemplate()  # -> Directories, Templates
geographic_boundary = GeographicBoundary(Left="-74.023399", Top="40.716702", Right="-74", Bottom="40.699799")  # -> Boundary, CoordinateReference
# Path to example file
python_3_script = Python3Script(x=workflow_template.Directories, y="2010_Census_Blocks_20260129.geojson")  # -> out, a
# ---------- python_3_script: Python ----------
import os

a = os.path.join(x,y)
# ---------- end python_3_script ----------
import_geojson_file = ImportGeojsonFile(GeojsonFilePath=python_3_script.a, CroppingBoundary=geographic_boundary.Boundary, Terrain=False, Run=True)  # -> Polylines, Polygons, Points, CoordinateReference, Boundary
