# Grasshopper definition 5_draw_map.gh (Grasshopper 1.0.8)
# plug-ins: Urbano2

# ----
# Mapped geometries and the metadata key
value_list = ValueList({"block_residential_population", "block_total_jobs", "block_job_shop", "block_job_leisure", "block_job_food", "block_job_admin", "block_job_manufacture", "block_job_professional", "block_job_school", "block_poi_shop", "block_poi_leisure", "block_poi_food", "block_poi_school", "block_poi_hotel", "block_poi_parking", "block_total_poi"}, selected="block_residential_population")
urbano_polyline = UrbanoPolyline([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])

# ----
# You can customize your map
# through Map Settings
button = Button()
urbano_gradient = UrbanoGradient(
    Reverse=button,
    stops=[0: RGB(75, 107, 169), 0.25: RGB(173, 203, 249), 0.5: RGB(254, 244, 84), 0.75: RGB(234, 126, 0), 1: RGB(234, 38, 0)])
map_settings = MapSettings(Gradient=urbano_gradient, Legend=True, LegendTitle=value_list, Label=True)

curve = Curve(urbano_polyline)
lookup_metadata = LookupMetadata(MetadataGeometry=curve, SearchKey=value_list)
boundary_surfaces = BoundarySurfaces(Edges=curve)
draw_map = DrawMap(Geometries=boundary_surfaces, Values=lookup_metadata, MapSettings=map_settings)
