# Grasshopper definition 1_project_setting.gh (Grasshopper 1.0.8)
# plug-ins: Urbano2

workflow_template = WorkflowTemplate()  # -> Directories, Templates, ExampleProjectSetting, ExampleOSMFilePath, ExampleShapefilePath, ExampleGeojsonPath
# Click this button to
# start generating your own
# project setting string
project_setting = ProjectSetting()
# Replace with your
# project setting
text = Text(workflow_template.ExampleProjectSetting)
import_public_transits = ImportPublicTransits(ProjectSetting=text, DataSource="osm", Terrain=True)  # -> TransitLines, TransitStops
import_green_spaces = ImportGreenSpaces(ProjectSetting=text, DataSource="osm", Terrain=True)  # -> GreenSpaces, Trees
import_streets = ImportStreets(ProjectSetting=text, DataSource="osm", Terrain=True)
import_terrain = ImportTerrain(ProjectSetting=text, Colored=True)
import_buildings = ImportBuildings(ProjectSetting=text, DataSource="osm", Terrain=True)  # -> _2DFootprints, _3DMeshes
