# Grasshopper definition 2_custom_import_osm_data.gh (Grasshopper 1.0.8)
# plug-ins: Urbano2

# Select a query from the dropdown
# or input a custom query (hover over the input side to see syntax)
osm_feature_query = OsmFeatureQuery(OsmFeatureQuery="(parking)")
workflow_template = WorkflowTemplate()  # -> Directories, Templates, ExampleProjectSetting, ExampleOSMFilePath, ExampleShapefilePath, ExampleGeojsonPath
panel = Panel(osm_feature_query)
import_osm_file = ImportOSMFile(OsmFilePath=workflow_template.ExampleOSMFilePath, OsmFeatures=panel, Terrain=False, Run=True)  # -> Polylines, Polygons, Points, CoordinateReference, Boundary
