# Grasshopper definition 6_route_on_street_network.gh (Grasshopper 1.0.8)
# plug-ins: Urbano2

workflow_template = WorkflowTemplate()  # -> Directories, Templates, ExampleProjectSetting, ExampleOSMFilePath, ExampleShapefilePath, ExampleGeojsonPath
deconstruct_project_setting = DeconstructProjectSetting(ProjectSetting=workflow_template.ExampleProjectSetting)  # -> Directory, Boundary, Granularity, DataLayers, DataFiles, CoordinateReference
import_streets = ImportStreets(ProjectSetting=workflow_template.ExampleProjectSetting, DataSource="osm", Terrain=False)
create_street_network = CreateStreetNetwork(StreetPolylines=import_streets, CoordinateReference=deconstruct_project_setting.CoordinateReference, CleanStreets=False)  # -> StreetNetwork, CoordinateReference
point = Point(Point(1167.815156, 1155.371873, 0))
point_2 = Point([Point(1106.406412, 1597.586329, 0), Point(745.0811683, 666.9975175, 0), Point(1493.150655, 861.4750678, 0)])
router = Router(
    Origin=point,
    Destination=point_2,
    TravelMode="(0): Walk",
    StreetNetwork=create_street_network.StreetNetwork,
    CoordinateReference=create_street_network.CoordinateReference,
    RoutingMetric="Comprehensive (Default)")  # -> Route, TravelTime, TravelDistance, CoordinateReference
