# Grasshopper definition test.gh (Grasshopper 1.0.8)

c_script = CSharpScript()  # -> out, a
# ---------- c_script: C# ----------
// Grasshopper Script Instance
#region Usings
using System;
using System.Linq;
using System.Collections;
using System.Collections.Generic;
using System.Drawing;

using Rhino;
using Rhino.Geometry;

using Grasshopper;
using Grasshopper.Kernel;
using Grasshopper.Kernel.Data;
using Grasshopper.Kernel.Types;
using System.Threading;
using System.Threading.Tasks;
using System.Net.Http;
using System.Net.Http.Headers;
using System.Text.Json;
#endregion

public class Script_Instance : GH_ScriptInstance
{
    #region Notes
    /* 
      Members:
        RhinoDoc RhinoDocument
        GH_Document GrasshopperDocument
        IGH_Component Component
        int Iteration

      Methods (Virtual & overridable):
        Print(string text)
        Print(string format, params object[] args)
        Reflect(object obj)
        Reflect(object obj, string method_name)
    */
    #endregion

    private void RunScript(object x, object y, ref object a)
    {
        // Write your logic here
        // usage
// List files synchronously (no await)
var files = GitHubFileLister.ListFilesSync("Urbano-io", "Urbano2-GH-Templates", "HEAD");

// Send to output
a = files;            

    }
}


static class GitHubFileLister
{
    // Synchronous wrapper (blocks until done)
    internal static List<string> ListFilesSync(string owner, string repo, string gitRef = "HEAD")
    {
        using var http = new HttpClient();
        http.DefaultRequestHeaders.UserAgent.ParseAdd("gh-file-list-ghscript");
        http.DefaultRequestHeaders.Accept.Add(new MediaTypeWithQualityHeaderValue("application/vnd.github+json"));
        http.DefaultRequestHeaders.Add("X-GitHub-Api-Version", "2022-11-28");

        var url = $"https://api.github.com/repos/{Uri.EscapeDataString(owner)}/{Uri.EscapeDataString(repo)}/git/trees/{Uri.EscapeDataString(gitRef)}?recursive=1";

        using var resp = http.GetAsync(url).GetAwaiter().GetResult();
        resp.EnsureSuccessStatusCode();

        using var stream = resp.Content.ReadAsStreamAsync().GetAwaiter().GetResult();
        using var doc = JsonDocument.Parse(stream);

        var list = new List<string>();
        foreach (var e in doc.RootElement.GetProperty("tree").EnumerateArray())
        {
            if (e.GetProperty("type").GetString() == "blob")
                list.Add(e.GetProperty("path").GetString());
        }
        return list;
    }
}
# ---------- end c_script ----------
panel = Panel([c_script.out, c_script.a])
