# Grasshopper definition 1_build_site_model.gh (Grasshopper 1.0.8)
# plug-ins: Urbano2

workflow_template = WorkflowTemplate()  # -> Directories, Templates, ExampleProjectSetting, ExampleOSMFilePath, ExampleShapefilePath, ExampleGeojsonPath
# Click this button to
# start generating your own
# project setting string
project_setting = ProjectSetting()
# Replace with your
# project setting
text = Text(workflow_template.ExampleProjectSetting)
import_buildings = ImportBuildings(ProjectSetting=text, DataSource="osm", Terrain=True)  # -> _2DFootprints, _3DMeshes
import_data_blocks = ImportDataBlocks(ProjectSetting=text, DataSource="urbano synthesized", Terrain=False)
import_amenities = ImportAmenities(ProjectSetting=text, DataSource="osm", Terrain=True)
import_green_spaces = ImportGreenSpaces(ProjectSetting=text, DataSource="osm", Terrain=True)  # -> GreenSpaces, Trees
import_streets = ImportStreets(ProjectSetting=text, DataSource="osm", Terrain=True)
import_public_transits = ImportPublicTransits(ProjectSetting=text, DataSource="osm", Terrain=True)  # -> TransitLines, TransitStops
import_terrain = ImportTerrain(ProjectSetting=text, Colored=True)

# ----
# Visualize blocks by population (based on 2010 US Census)
panel = Panel("block_residential_population")
lookup_metadata = LookupMetadata(MetadataGeometry=import_data_blocks, SearchKey=panel)
urbano_gradient = UrbanoGradient(
    Reverse=Button(),
    stops=[0: RGB(75, 107, 169), 0.25: RGB(173, 203, 249), 0.5: RGB(254, 244, 84), 0.75: RGB(234, 126, 0), 1: RGB(234, 38, 0)])
unit_y = UnitY(Factor=Slider(4000, range=0..5000))
move = Move(Geometry=import_data_blocks, Motion=unit_y)  # -> Geometry, Transform
map_settings = MapSettings(Gradient=urbano_gradient, Legend=True, LegendTitle="Census Block Population", Label=False)
mesh = Mesh(move.Geometry)
draw_map = DrawMap(Geometries=mesh, Values=lookup_metadata, MapSettings=map_settings)
custom_preview = CustomPreview(Geometry=move.Geometry, Material=ColourSwatch(SwatchColor=RGB(255, 254, 255)))

# ----
# Visualize amenities by type (based on OSM tags)
panel_2 = Panel("URBANO_ActivityType")
lookup_metadata_2 = LookupMetadata(MetadataGeometry=import_amenities, SearchKey=panel_2)
unit_y_2 = UnitY(Factor=Slider(8000, range=0..10000))
point = Point(import_amenities)
urbano_gradient_2 = UrbanoGradient(Reverse=Button(), stops=[0: RGB(255, 38, 0), 0.5: RGB(254, 251, 0), 1: RGB(0, 142, 0)])
move_2 = Move(Geometry=point, Motion=unit_y_2)  # -> Geometry, Transform
map_settings_2 = MapSettings(
    Gradient=urbano_gradient_2,
    Legend=True,
    LegendTitle="Amenity Type (Derived from Osm Tag)",
    Label=False,
    LinewidthRange="2 to 5")
rectangle = Rectangle(Plane=move_2.Geometry, XSize="-3 to 3", YSize="-3 to 3", Radius=0)  # -> Rectangle, Length
surface = Surface(rectangle.Rectangle)
draw_map_2 = DrawMap(Geometries=surface, Values=lookup_metadata_2, MapSettings=map_settings_2)

# ----
# Visualize building by type (based on OSM tags)
panel_3 = Panel("building")
lookup_metadata_3 = LookupMetadata(MetadataGeometry=import_buildings._3DMeshes, SearchKey=panel_3)
urbano_gradient_3 = UrbanoGradient(
    Reverse=Button(),
    stops=[0: RGB(243, 57, 0), 0.1: RGB(247, 159, 20), 0.2: RGB(220, 237, 32), 0.3: RGB(79, 186, 8), 0.4: RGB(18, 178, 90), 0.5: RGB(1, 192, 229), 0.6: RGB(39, 72, 161), 0.7: RGB(103, 0, 120), 0.8: RGB(210, 0, 118), 0.9: RGB(236, 27, 60), 1: RGB(243, 57, 0)])
unit_y_3 = UnitY(Factor=Slider(2000, range=0..5000))
move_3 = Move(Geometry=import_buildings._3DMeshes, Motion=unit_y_3)  # -> Geometry, Transform
map_settings_3 = MapSettings(Gradient=urbano_gradient_3, Legend=True, LegendTitle="OSM Building Tag", Label=False)
mesh_2 = Mesh(move_3.Geometry)
draw_map_3 = DrawMap(Geometries=mesh_2, Values=lookup_metadata_3, MapSettings=map_settings_3)

# ----
# Visualize streets by type (based on OSM tags)
panel_4 = Panel("highway")
lookup_metadata_4 = LookupMetadata(MetadataGeometry=import_streets, SearchKey=panel_4)
urbano_gradient_4 = UrbanoGradient(
    Reverse=Button(),
    stops=[0: RGB(243, 57, 0), 0.1: RGB(236, 27, 60), 0.2: RGB(210, 0, 118), 0.3: RGB(103, 0, 120), 0.4: RGB(39, 72, 161), 0.5: RGB(1, 192, 229), 0.6: RGB(18, 178, 90), 0.7: RGB(79, 186, 8), 0.8: RGB(220, 237, 32), 0.9: RGB(247, 159, 20), 1: RGB(243, 57, 0)])
unit_y_4 = UnitY(Factor=Slider(6000, range=0..10000))
move_4 = Move(Geometry=import_streets, Motion=unit_y_4)  # -> Geometry, Transform
map_settings_4 = MapSettings(Gradient=urbano_gradient_4, Legend=True, LegendTitle="OSM Street Tag", Label=False, LinewidthRange="2 to 5")
draw_map_4 = DrawMap(Geometries=move_4.Geometry, Values=lookup_metadata_4, MapSettings=map_settings_4)
