# Grasshopper definition 2_compute_walkscore_by_block.gh (Grasshopper 1.0.8)
# plug-ins: Urbano2

workflow_template = WorkflowTemplate()  # -> Directories, Templates, ExampleProjectSetting, ExampleOSMFilePath, ExampleShapefilePath, ExampleGeojsonPath
deconstruct_project_setting = DeconstructProjectSetting(ProjectSetting=workflow_template.ExampleProjectSetting)  # -> Directory, Boundary, Granularity, DataLayers, DataFiles, CoordinateReference
import_data_blocks = ImportDataBlocks(ProjectSetting=workflow_template.ExampleProjectSetting, DataSource="urbano synthesized", Terrain=False)
import_amenities = ImportAmenities(ProjectSetting=workflow_template.ExampleProjectSetting, DataSource="osm", Terrain=False)

# ----
# Compute Walkscore for input geometries
button = Button()
walkscore_component = WalkscoreComponent(
    Amenities=import_amenities,
    Geometries=import_data_blocks,
    CoordinateReference=deconstruct_project_setting.CoordinateReference,
    Run=button,
    WalkscoreCachedScores_0=81.03647953,
    WalkscoreCachedScores_1=82.03297495,
    WalkscoreCachedScores_10=79.83920214,
    WalkscoreCachedScores_100=85.51334496,
    WalkscoreCachedScores_101=76.24254874,
    WalkscoreCachedScores_102=75.18434843,
    WalkscoreCachedScores_103=80.77131538,
    WalkscoreCachedScores_104=83.84917394,
    WalkscoreCachedScores_105=81.75520928,
    WalkscoreCachedScores_106=84.52480673,
    WalkscoreCachedScores_107=86.00788398,
    WalkscoreCachedScores_108=81.81212888,
    WalkscoreCachedScores_109=83.82912769,
    WalkscoreCachedScores_11=67.01949123,
    WalkscoreCachedScores_110=83.65413263,
    WalkscoreCachedScores_111=81.2523328,
    WalkscoreCachedScores_112=84.25360356,
    WalkscoreCachedScores_113=79.54057913,
    WalkscoreCachedScores_114=81.24855185,
    WalkscoreCachedScores_115=81.07067841,
    WalkscoreCachedScores_116=80.4535507,
    WalkscoreCachedScores_117=84.72388532,
    WalkscoreCachedScores_118=85.45542578,
    WalkscoreCachedScores_119=82.09537936,
    WalkscoreCachedScores_12=84.34875844,
    WalkscoreCachedScores_120=83.78338007,
    WalkscoreCachedScores_121=72.84013675,
    WalkscoreCachedScores_122=80.53186133,
    WalkscoreCachedScores_123=78.68917897,
    WalkscoreCachedScores_124=80.30272945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)  # -> Geometries, Walkscores

# ----
# Visualize
urbano_gradient = UrbanoGradient(
    Reverse=False,
    stops=[0: RGB(75, 107, 169), 0.128: RGB(254, 244, 84), 0.25: RGB(173, 203, 249), 0.75: RGB(234, 126, 0), 1: RGB(234, 38, 0)])
map_settings = MapSettings(Gradient=urbano_gradient, Max="85", Min=Slider(75, range=50..100), Legend=True, LegendTitle="Walkscore", Label=False)
surface = Surface(walkscore_component.Geometries)
draw_map = DrawMap(Geometries=surface, Values=walkscore_component.Walkscores, MapSettings=map_settings)
