# Grasshopper definition 3_compute_BC.gh (Grasshopper 1.0.8)
# plug-ins: Urbano2

workflow_template = WorkflowTemplate()  # -> Directories, Templates, ExampleProjectSetting, ExampleOSMFilePath, ExampleShapefilePath, ExampleGeojsonPath
import_streets = ImportStreets(ProjectSetting=workflow_template.ExampleProjectSetting, DataSource="osm", Terrain=False)
deconstruct_project_setting = DeconstructProjectSetting(ProjectSetting=workflow_template.ExampleProjectSetting)  # -> Directory, Boundary, Granularity, DataLayers, DataFiles, CoordinateReference
create_street_network = CreateStreetNetwork(
    StreetPolylines=import_streets,
    StreetMeta=import_streets,
    CoordinateReference=deconstruct_project_setting.CoordinateReference,
    CleanStreets=False)  # -> StreetNetwork, CoordinateReference
betwcent = BetweennessCentrality(StreetNetwork=create_street_network.StreetNetwork, CoordinateReference=create_street_network.CoordinateReference)  # -> StreetSegments, BetweennessCentrality
urbano_gradient = UrbanoGradient(Reverse=True, stops=[0: RGB(255, 38, 0), 0.5: RGB(254, 251, 0), 1: RGB(0, 142, 0)])
map_settings = MapSettings(Gradient=urbano_gradient, Legend=True, LegendTitle="Walkscore", Label=False)
draw_map = DrawMap(Geometries=betwcent.StreetSegments, Values=betwcent.BetweennessCentrality, MapSettings=map_settings)
