# Grasshopper definition 3_customize_walkscore.gh (Grasshopper 1.0.8)
# plug-ins: Urbano2

workflow_template = WorkflowTemplate()  # -> Directories, Templates, ExampleProjectSetting, ExampleOSMFilePath, ExampleShapefilePath, ExampleGeojsonPath
deconstruct_project_setting = DeconstructProjectSetting(ProjectSetting=workflow_template.ExampleProjectSetting)  # -> Directory, Boundary, Granularity, DataLayers, DataFiles, CoordinateReference
import_data_blocks = ImportDataBlocks(ProjectSetting=workflow_template.ExampleProjectSetting, DataSource="urbano synthesized", Terrain=False)
import_amenities = ImportAmenities(ProjectSetting=workflow_template.ExampleProjectSetting, DataSource="osm", Terrain=False)

# ----
# Add new amenities to increase walkscore
panel = Panel("something")
create_metadata = CreateMetadata(Keys="food", Values=panel)
point = Point([Point(1659.447599, 1036.750762, 0), Point(1685.603754, 1131.203869, 0), Point(1839.301901, 1191.854421, 0), Point(1672.750122, 1430.011869, 0), Point(1534.224587, 1522.461856, 0), Point(1612.628578, 1626.412827, 0)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])
embed_metadata_into_point = EmbedMetadataIntoPoint(Point=point, Metadata=create_metadata)
merge = Merge(Data1=embed_metadata_into_point, Data2=import_amenities)  # -> flatten(Result)

# ----
# Customize amenity types and weights for walkscore computation
category_tags = CategoryTags(Tree({0}: ["shop=supermarket", "shop=grocery", "shop=greengrocer", "amenity=marketplace"], {1}: ["amenity=restaurant", "amenity=fast_food", "amenity=cafe", "food=*"], {2}: ["shop=*"], {3}: ["amenity=school", "amenity=library", "amenity=townhall", "amenity=community_centre", "amenity=university", "amenity=post_office"], {4}: ["leisure=park", "natural=tree", "landuse=grass"], {5}: ["amenity=hospital", "amenity=clinic", "amenity=doctors", "amenity=pharmacy", "amenity=dentist"]))
category_caps = CategoryCaps([1.5, 3, 2, 1, 1.5, 1.5])
category_weights = CategoryWeights([3, 3, 2, 1, 2, 2])
category_names = CategoryNames(["Grocery", "Food", "Retail", "Civic", "Green", "Health"])
panel_2 = Panel(category_names)
panel_3 = Panel(category_weights)
panel_4 = Panel(category_caps)
panel_5 = Panel(category_tags)
walkscore_settings = WalkscoreSettings(
    CategoryNames=panel_2,
    CategoryTags=panel_5,
    CategoryWeights=panel_3,
    CategoryCaps=panel_4,
    MaxWalkDistance=1600,
    DecayMinWeight=0.1,
    KCount=3)

# ----
# Baseline walkscore
walkscore_component = WalkscoreComponent(
    Amenities=import_amenities,
    Geometries=import_data_blocks,
    CoordinateReference=deconstruct_project_setting.CoordinateReference,
    Run=True,
    WalkscoreCachedScores_0=81.03647953,
    WalkscoreCachedScores_1=82.03297495,
    WalkscoreCachedScores_10=79.83920214,
    WalkscoreCachedScores_100=85.51334496,
    WalkscoreCachedScores_101=76.24254874,
    WalkscoreCachedScores_102=75.18434843,
    WalkscoreCachedScores_103=80.77131538,
    WalkscoreCachedScores_104=83.84917394,
    WalkscoreCachedScores_105=81.75520928,
    WalkscoreCachedScores_106=84.52480673,
    WalkscoreCachedScores_107=86.00788398,
    WalkscoreCachedScores_108=81.81212888,
    WalkscoreCachedScores_109=83.82912769,
    WalkscoreCachedScores_11=67.01949123,
    WalkscoreCachedScores_110=83.65413263,
    WalkscoreCachedScores_111=81.2523328,
    WalkscoreCachedScores_112=84.25360356,
    WalkscoreCachedScores_113=79.54057913,
    WalkscoreCachedScores_114=81.24855185,
    WalkscoreCachedScores_115=81.07067841,
    WalkscoreCachedScores_116=80.4535507,
    WalkscoreCachedScores_117=84.72388532,
    WalkscoreCachedScores_118=85.45542578,
    WalkscoreCachedScores_119=82.09537936,
    WalkscoreCachedScores_12=84.34875844,
    WalkscoreCachedScores_120=83.78338007,
    WalkscoreCachedScores_121=72.84013675,
    WalkscoreCachedScores_122=80.53186133,
    WalkscoreCachedScores_123=78.68917897,
    WalkscoreCachedScores_124=80.30272945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)  # -> Geometries, Walkscores

# ----
# Updated walkscore
walkscore_component_2 = WalkscoreComponent(
    Amenities=merge,
    Geometries=import_data_blocks,
    CoordinateReference=deconstruct_project_setting.CoordinateReference,
    Settings=walkscore_settings,
    Run=True,
    WalkscoreCachedScores_0=81.03647953,
    WalkscoreCachedScores_1=82.03297495,
    WalkscoreCachedScores_10=83.27442069,
    WalkscoreCachedScores_100=85.51334496,
    WalkscoreCachedScores_101=84.01598492,
    WalkscoreCachedScores_102=75.18434843,
    WalkscoreCachedScores_103=80.77131538,
    WalkscoreCachedScores_104=83.84917394,
    WalkscoreCachedScores_105=81.75520928,
    WalkscoreCachedScores_106=84.52480673,
    WalkscoreCachedScores_107=86.00788398,
    WalkscoreCachedScores_108=81.81212888,
    WalkscoreCachedScores_109=83.82912769,
    WalkscoreCachedScores_11=74.87245243,
    WalkscoreCachedScores_110=83.65413263,
    WalkscoreCachedScores_111=81.2523328,
    WalkscoreCachedScores_112=84.25360356,
    WalkscoreCachedScores_113=79.54057913,
    WalkscoreCachedScores_114=81.24855185,
    WalkscoreCachedScores_115=81.07067841,
    WalkscoreCachedScores_116=80.4535507,
    WalkscoreCachedScores_117=84.72388532,
    WalkscoreCachedScores_118=85.45542578,
    WalkscoreCachedScores_119=82.92909681,
    WalkscoreCachedScores_12=84.34875844,
    WalkscoreCachedScores_120=83.78338007,
    WalkscoreCachedScores_121=80.33644089,
    WalkscoreCachedScores_122=80.53186133,
    WalkscoreCachedScores_123=78.68917897,
    WalkscoreCachedScores_124=80.30272945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)  # -> Geometries, Walkscores

# ----
# Visualize
panel_6 = Panel("2000")
geometry = Geometry(walkscore_component.Geometries)
unit_y = UnitY(Factor=panel_6)
move = Move(Geometry=geometry, Motion=unit_y)  # -> Geometry, Transform
urbano_gradient = UrbanoGradient(
    Reverse=False,
    stops=[0: RGB(75, 107, 169), 0.128: RGB(254, 244, 84), 0.25: RGB(173, 203, 249), 0.75: RGB(234, 126, 0), 1: RGB(234, 38, 0)])
merge_2 = Merge(Data1=move.Geometry, Data2=walkscore_component_2.Geometries)
merge_3 = Merge(Data1=walkscore_component.Walkscores, Data2=walkscore_component_2.Walkscores)
map_settings = MapSettings(Gradient=urbano_gradient, Max="85", Min=Slider(75, range=50..100), Legend=True, LegendTitle="Walkscore", Label=False)
surface = Surface(merge_2)
draw_map = DrawMap(Geometries=surface, Values=merge_3, MapSettings=map_settings)
