# Grasshopper definition 3_customized_walkscore.gh (Grasshopper 1.0.8)
# plug-ins: Urbano2

workflow_template = WorkflowTemplate()  # -> Directories, Templates, ExampleProjectSetting, ExampleOSMFilePath, ExampleShapefilePath, ExampleGeojsonPath

# ----
# Customize amenity types and weights for walkscore computation
category_tags = CategoryTags(Tree({0}: ["shop=supermarket", "shop=grocery", "shop=greengrocer", "amenity=marketplace"], {1}: ["amenity=restaurant", "amenity=fast_food", "amenity=cafe", "food=*"], {2}: ["shop=*"], {3}: ["amenity=school", "amenity=library", "amenity=townhall", "amenity=community_centre", "amenity=university", "amenity=post_office"], {4}: ["leisure=park", "natural=tree", "landuse=grass"], {5}: ["amenity=hospital", "amenity=clinic", "amenity=doctors", "amenity=pharmacy", "amenity=dentist"]))
category_caps = CategoryCaps([1.5, 3, 2, 1, 1.5, 1.5])
category_weights = CategoryWeights([3, 3, 2, 1, 2, 2])
category_names = CategoryNames(["Grocery", "Food", "Retail", "Civic", "Green", "Health"])
panel = Panel(category_weights)
panel_2 = Panel(category_names)
panel_3 = Panel(category_caps)
panel_4 = Panel(category_tags)
walkscore_settings = WalkscoreSettings(
    CategoryNames=panel_2,
    CategoryTags=panel_4,
    CategoryWeights=panel,
    CategoryCaps=panel_3,
    MaxWalkDistance=1600,
    DecayMinWeight=0.1,
    KCount=3)

deconstruct_project_setting = DeconstructProjectSetting(ProjectSetting=workflow_template.ExampleProjectSetting)  # -> Directory, Boundary, Granularity, DataLayers, DataFiles, CoordinateReference
import_data_blocks = ImportDataBlocks(ProjectSetting=workflow_template.ExampleProjectSetting, DataSource="urbano synthesized", Terrain=False)
import_amenities = ImportAmenities(ProjectSetting=workflow_template.ExampleProjectSetting, DataSource="osm", Terrain=False)

# ----
# Add new amenities to increase walkscore
panel_5 = Panel("something")
create_metadata = CreateMetadata(Keys="food", Values=panel_5)
point = Point([Point(1779.906309, 1705.28469, 0), Point(1747.316757, 1649.668418, 0), Point(1747.110232, 1630.732986, 0), Point(1767.288785, 1600.378953, 0), Point(1771.714874, 1575.689367, 0), Point(1762.513984, 1560.872588, 0), Point(1755.736487, 1548.201287, 0), Point(1743.614992, 1538.499158, 0), Point(1744.899103, 1507.777009, 0), Point(1763.251637, 1472.311587, 0), Point(1790.664073, 1440.432684, 0), Point(1797.915967, 1405.357023, 0), Point(1797.167218, 1368.744569, 0), Point(1795.021187, 1350.090063, 0), Point(1792.433153, 1314.322028, 0), Point(1777.699341, 1273.791477, 0), Point(1735.481496, 1250.909187, 0)])
embed_metadata_into_point = EmbedMetadataIntoPoint(Point=point, Metadata=create_metadata)
merge = Merge(Data1=embed_metadata_into_point, Data2=import_amenities)  # -> flatten(Result)

walkscore_component = WalkscoreComponent(
    Amenities=merge,
    Geometries=import_data_blocks,
    CoordinateReference=deconstruct_project_setting.CoordinateReference,
    Settings=walkscore_settings,
    Run=Button(),
    WalkscoreCachedScores_0=81.03647953,
    WalkscoreCachedScores_1=82.03297495,
    WalkscoreCachedScores_10=79.83920214,
    WalkscoreCachedScores_100=85.51334496,
    WalkscoreCachedScores_101=81.89582336,
    WalkscoreCachedScores_102=75.18434843,
    WalkscoreCachedScores_103=80.77131538,
    WalkscoreCachedScores_104=83.84917394,
    WalkscoreCachedScores_105=81.75520928,
    WalkscoreCachedScores_106=84.52480673,
    WalkscoreCachedScores_107=86.00788398,
    WalkscoreCachedScores_108=81.81212888,
    WalkscoreCachedScores_109=83.82912769,
    WalkscoreCachedScores_11=73.34849158,
    WalkscoreCachedScores_110=83.65413263,
    WalkscoreCachedScores_111=81.2523328,
    WalkscoreCachedScores_112=84.25360356,
    WalkscoreCachedScores_113=79.54057913,
    WalkscoreCachedScores_114=81.24855185,
    WalkscoreCachedScores_115=81.07067841,
    WalkscoreCachedScores_116=80.4535507,
    WalkscoreCachedScores_117=84.72388532,
    WalkscoreCachedScores_118=85.45542578,
    WalkscoreCachedScores_119=82.09537936,
    WalkscoreCachedScores_12=84.34875844,
    WalkscoreCachedScores_120=83.78338007,
    WalkscoreCachedScores_121=80.83272769,
    WalkscoreCachedScores_122=80.53186133,
    WalkscoreCachedScores_123=78.68917897,
    WalkscoreCachedScores_124=80.30272945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)  # -> Geometries, Walkscores

urbano_gradient = UrbanoGradient(
    Reverse=False,
    stops=[0: RGB(75, 107, 169), 0.128: RGB(254, 244, 84), 0.25: RGB(173, 203, 249), 0.75: RGB(234, 126, 0), 1: RGB(234, 38, 0)])
map_settings = MapSettings(Gradient=urbano_gradient, Max="85", Min=Slider(75, range=50..100), Legend=True, LegendTitle="Walkscore", Label=False)
surface = Surface(walkscore_component.Geometries)
draw_map = DrawMap(Geometries=surface, Values=walkscore_component.Walkscores, MapSettings=map_settings)
