# Grasshopper definition 5_compute_betweenness_centrality.gh (Grasshopper 1.0.8)
# plug-ins: Urbano2

workflow_template = WorkflowTemplate()  # -> Directories, Templates, ExampleProjectSetting, ExampleOSMFilePath, ExampleShapefilePath, ExampleGeojsonPath
deconstruct_project_setting = DeconstructProjectSetting(ProjectSetting=workflow_template.ExampleProjectSetting)  # -> Directory, Boundary, Granularity, DataLayers, DataFiles, CoordinateReference
import_streets = ImportStreets(ProjectSetting=workflow_template.ExampleProjectSetting, DataSource="osm", Terrain=False)

# ----
# Create street network and compute centrality
create_street_network = CreateStreetNetwork(StreetPolylines=import_streets, CoordinateReference=deconstruct_project_setting.CoordinateReference, CleanStreets=False)  # -> StreetNetwork, CoordinateReference
betwcent = BetweennessCentrality(StreetNetwork=create_street_network.StreetNetwork)  # -> StreetSegments, BetweennessCentrality

urbano_gradient = UrbanoGradient(Reverse=False, stops=[0: RGB(0, 142, 0), 0.5: RGB(254, 251, 0), 1: RGB(255, 38, 0)])
map_settings = MapSettings(
    Gradient=urbano_gradient,
    Max="3000000",
    Min="100000",
    Legend=True,
    LegendTitle="Centrality",
    Label=False,
    LinewidthRange="1 to 6")
draw_map = DrawMap(Geometries=betwcent.StreetSegments, Values=betwcent.BetweennessCentrality, MapSettings=map_settings)
