# Grasshopper definition 6_compute_betweenness_centrality_before_after.gh (Grasshopper 1.0.8)
# plug-ins: Urbano2

workflow_template = WorkflowTemplate()  # -> Directories, Templates, ExampleProjectSetting, ExampleOSMFilePath, ExampleShapefilePath, ExampleGeojsonPath
deconstruct_project_setting = DeconstructProjectSetting(ProjectSetting=workflow_template.ExampleProjectSetting)  # -> Directory, Boundary, Granularity, DataLayers, DataFiles, CoordinateReference
import_streets = ImportStreets(ProjectSetting=workflow_template.ExampleProjectSetting, DataSource="osm", Terrain=False)

# ---- group: Add 2 streets
street_metadata = StreetMetadata(StreetType="primary", CanWalk=True, CanBike=True, CanDrive=True)
geo = Geometry([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])
metacurve = EmbedMetadataIntoCurve(Curve=geo, Metadata=street_metadata)
preview = CustomPreview(Geometry=geo, Material=ColourSwatch(SwatchColor=RGB(255, 0, 255)))

# ----
merge = Merge(Data1=import_streets, Data2=metacurve)  # -> flatten(Result)
create_street_network = CreateStreetNetwork(StreetPolylines=import_streets, CoordinateReference=deconstruct_project_setting.CoordinateReference, CleanStreets=False)  # -> StreetNetwork, CoordinateReference
create_street_network_2 = CreateStreetNetwork(StreetPolylines=merge, CoordinateReference=deconstruct_project_setting.CoordinateReference, CleanStreets=False)  # -> StreetNetwork, CoordinateReference
betwcent = BetweennessCentrality(StreetNetwork=create_street_network.StreetNetwork)  # -> StreetSegments, BetweennessCentrality
betwcent_2 = BetweennessCentrality(StreetNetwork=create_street_network_2.StreetNetwork)  # -> StreetSegments, BetweennessCentrality
midpt = CurveMiddle(Curve=betwcent.StreetSegments)
midpt_2 = CurveMiddle(Curve=betwcent_2.StreetSegments)

# ---- group: 4 Street Segments have no exact match --> exclude
cp = ClosestPoint(Point=graft(midpt_2), Cloud=midpt)  # -> ClosestPoint, flatten(CPIndex), flatten(Distance)
sort = SortList(Keys=cp.Distance, ValuesA=cp.CPIndex)  # -> Keys, ValuesA
panel = Panel(sort.Keys)
panel_2 = Panel(sort.ValuesA)

# ----
item = ListItem(List=betwcent.BetweennessCentrality, Index=cp.CPIndex, Wrap=True)

# ---- group: Mapping
percentage_difference = Python3Script(A=betwcent_2.BetweennessCentrality, B=item, C=cp.Distance)  # -> out, a; inputs A: list, B: list, C: list
# ---------- percentage_difference: Python ----------
a = []
for af, bf, d in zip(A, B, C):
    if d >= 0.01:
        # New street — no match in BEFORE
        a.append(999)
    elif bf > 0.001:
        pct = ((af - bf) / bf) * 100
        a.append(max(-100, min(200, pct)))
    else:
        # Was ~0 before, still ~0 now
        a.append(0)
# ---------- end percentage_difference ----------
urbano_gradient = UrbanoGradient(Reverse=Toggle(True), stops=[0: RGB(255, 38, 0), 0.5: RGB(255, 255, 255), 1: RGB(0, 142, 0)])
map_settings = MapSettings(
    Gradient=urbano_gradient,
    Max="100",
    Min="-100",
    Legend=True,
    LegendTitle="Betweenness Centrality Difference [%]",
    Label=False,
    LinewidthRange="1 to 10")
draw_map = DrawMap(Geometries=betwcent_2.StreetSegments, Values=percentage_difference.a, MapSettings=map_settings)

# ----
panel_3 = Panel(betwcent.BetweennessCentrality)
panel_4 = Panel(item)
panel_5 = Panel(percentage_difference.a)
